# Grasshopper definition project1visualization.gh (Grasshopper 1.0.7)
# plug-ins: LunchBox

circle = Circle()
pt = Point(<point referenced from the Rhino model>)
path = FilePath("C:\Users\bemin\Documents\EDUCATIONAL RESOURCES\Columbia University\SPRING 19' (TEMP)\DATA VIZ\DataVis_ProjectFolder\Project 1\CurseData.csv")
input = DataInput(UpdateDelay=5)
path_2 = DataPath()
file = ReadFile(File=path, PerLineParse=True)
flip = Flip()  # -> Surface, Result
csv = ReadCSV(CSVString=file, Delimiter=",")  # -> Headers, Values
panel = Panel(file)
panel_2 = Panel(csv.Values)
panel_3 = Panel(csv.Headers)
flip_2 = FlipMatrix(Data=panel)
subset = SubSet(SetA=panel)

# ---- group: # of Curse
branch = TreeBranch(Tree=panel_2, Path=Slider(12, range=0..100), MaintainPaths=True)
panel_4 = Panel(branch)
rev = ReverseList(List=panel_4)
panel_5 = Panel(rev)

# ---- group: elapsed time btw curse
branch_2 = TreeBranch(Tree=panel_2, Path=Slider(10, range=0..100), MaintainPaths=True)
panel_6 = Panel(branch_2)
rev_2 = ReverseList(List=panel_6)
panel_7 = Panel(rev_2)

# ----
panel_8 = Panel(flip_2)

# ---- group: Circle Radius asa function of Area
pi = Pi(Factor=Slider(1, range=0..1))
division = Division(A=panel_5, B=pi)
sqrt = SquareRoot(Value=division)

# ----
multiplication = Multiplication(A=panel_7, B=Slider(10, range=0..1000))
pt_2 = ConstructPoint(XCoordinate=multiplication, YCoordinate=Slider(0, range=0..100), ZCoordinate=Slider(0, range=0..100))
panel_9 = Panel(pt_2)
circle_2 = CircleCNR(Center=panel_9, Normal=Vector(0, 0, 1), Radius=sqrt)
area = Area()  # -> Area, Centroid
move = Move(Motion=Vector(0, 0, 10))  # -> Geometry, Transform
series = Series(Start=0, Step=1, Count=10)
pdecon = Deconstruct()  # -> XComponent, YComponent, ZComponent
